# Grasshopper definition wallconstructor.gh (Grasshopper 0.9.76)
# plug-ins: Python Interpreter, Human UI

run = BooleanToggle(True)
# ▲中身
color = ValueList({"Amber", "Blue", "Brown", "Cobalt", "Crimson", "Cyan", "Emerald", "Green", "Indigo", "Lime", "Magenta", "Mauve", "Olive", "Orange", "Pink", "Purple", "Red", "Sienna", "Steel", "Taupe", "Teal", "Violet", "Yellow"}, selected="Green")

# ---- group: wall crvs
crv = Curve([<curve referenced from the Rhino model> x14])

# ---- group: それぞれのボタンのデフォルトの状態
toggle = BooleanToggle(True)
toggle_2 = BooleanToggle(False)

toggle_3 = BooleanToggle(False)

# ----
# 文字や
# 数値の設定
panel = Panel("過去のプレビュー(数が多いと重くなる)")
panel_2 = Panel("途中でベイクする(再開するときはチェックを外す)")
曲線のしるしのいろ = ColourSwatch(SwatchColor=RGB(0, 255, 132))
今見ている壁の色 = ColourSwatch(SwatchColor=RGBA(222, 47, 47, 159))
仮決定した壁の色 = ColourSwatch(SwatchColor=RGB(255, 255, 255))
panel_3 = Panel("""50
100
150
200""")
panel_4 = Panel("""50
100
150
200""")
中点のいろ = ColourSwatch(SwatchColor=RGB(128, 128, 128))
中点のいろ_2 = ColourSwatch(SwatchColor=RGB(67, 222, 219))
panel_5 = Panel("""すべての曲線
処理した曲線""")
壁の厚さ = Slider(200, range=0..1000)
壁の高さ = Slider(3000, range=2000..6000)
panel_6 = Panel("""長いカーブの長さに揃える
短いカーブの長さに揃える""")
# ▼インターフェース
panel_7 = Panel("wallconstructor")

# ---- group: タブのサイズ
number_slider = Slider(19, range=0..100)

# ---- group: ここで決めた値にスナップする
number_slider_2 = Slider(200, range=0..1000)

number_slider_3 = Slider(1000, range=0..1000)

# ---- group: ウィンドウのサイズ
number_slider_4 = Slider(550, range=0..1000)
number_slider_5 = Slider(400, range=0..1000)

# ---- group: タブの文字
panel_8 = Panel("""main
bake
option""")

# ---- group: ウィンドウの作成
launchwin = LaunchWindow(Show=run, Name=panel_7, Width=number_slider_5, Height=number_slider_4, ChildStatus=0, EnableHorizScroll=False)
winprops = SetWindowProperties(Window=launchwin, AccentColor=color, ShowTitleBar=True, ScaleFactor=1)

# ----
explode = Explode(Curve=crv, Recursive=True)  # -> Segments, Vertices
# 原点を中心に大きな円を描き、
# その円に沿って壁の線を順番に並べる
number_slider_6 = Slider(210080, range=0..500000)
crv_2 = Curve(flatten(explode.Segments))
pt = Point(Point(0, 0, 0))
curvepoint = PointOnCurve(crv_2, parameter=0.5)
cir = Circle(Plane=pt, Radius=number_slider_6)
alongcrv = SortAlongCurve(Points=curvepoint, Curve=cir)  # -> Points, Indices
item = ListItem(List=crv_2, Index=alongcrv.Indices, Wrap=True)

# ---- group: ソート済み
crv_3 = Curve(flatten(item))

# ---- group: 選択した全曲線数
lng = ListLength(List=crv_3)

# ----
# 要素の配置
toggle_4 = CreateToggle(Default=False, OnLabel="on", OffLabel="off")
toggle_5 = CreateToggle(Default=toggle, OnLabel="on", OffLabel="off")
pulldown = CreatePulldownMenu(ListItems=panel_3, SelectedIndex=2, showLabel=True)
pulldown_2 = CreatePulldownMenu(ListItems=panel_4, SelectedIndex=2, showLabel=True)
colorpicker = CreateColorPicker(DefaultColor=今見ている壁の色)
colorpicker_2 = CreateColorPicker(DefaultColor=仮決定した壁の色)
colorpicker_3 = CreateColorPicker(DefaultColor=曲線のしるしのいろ)
colorpicker_4 = CreateColorPicker(DefaultColor=中点のいろ)
colorpicker_5 = CreateColorPicker(DefaultColor=中点のいろ_2)
checkbox = CreateCheckbox(Label=panel_2, StartingValue=False)
expander = CreateExpander(UIElements=toggle_5, Header="ズーム", Open=toggle_2)
expander_2 = CreateExpander(UIElements=toggle_4, Header=panel, Open=toggle_2)
expander_3 = CreateExpander(UIElements=pulldown, Header="曲線のインデックスの大きさ", Open=toggle_2)
expander_4 = CreateExpander(UIElements=pulldown_2, Header="曲線の目印の大きさ", Open=toggle_2)
expander_5 = CreateExpander(UIElements=colorpicker, Header="今見ている壁の色", Open=toggle_3)
expander_6 = CreateExpander(UIElements=colorpicker_2, Header="仮決定した壁の色", Open=toggle_3)
expander_7 = CreateExpander(UIElements=colorpicker_3, Header="曲線の目印の色", Open=toggle_3)
expander_8 = CreateExpander(UIElements=colorpicker_4, Header="曲線の中点の色", Open=toggle_3)
expander_9 = CreateExpander(UIElements=colorpicker_5, Header="曲線のインデックスの色", Open=toggle_3)
pulldown_3 = CreatePulldownMenu(Label="端の調整", ListItems=panel_6, showLabel=True)
slider = CreateSlider(
    Slider=壁の厚さ,
    SnapValue=number_slider_2,
    ShowBounds=False,
    showLabel=True,
    ShowTicks=True,
    ShowTooltip=True,
    ShowValLabel=False)
slider_2 = CreateSlider(
    Slider=壁の高さ,
    SnapValue=number_slider_3,
    ShowBounds=False,
    showLabel=True,
    ShowTicks=True,
    ShowTooltip=True,
    ShowValLabel=False)
button = CreateButton(ButtonName="○が不要な線", ButtonStyle=0)
button_2 = CreateButton(ButtonName="✕が違う線", ButtonStyle=0)
button_3 = CreateButton(ButtonName="戻る", ButtonStyle=0)
button_4 = CreateButton(ButtonName="進む", ButtonStyle=0)

# ---- group: 要素を横に並べる
stack = CreateStack(UIElements=[button, button_2], Horizontal=True)  # -> flatten(Stack)
stack_2 = CreateStack(UIElements=[button_3, button_4], Horizontal=True)  # -> flatten(Stack)

# ----
# HumanUIの外で
# 読み込めるデータに変換する
panel_9 = Panel(panel_2)
panel_10 = Panel("今見ている壁の色")
panel_11 = Panel("仮決定した壁の色")
panel_12 = Panel("曲線の目印の色")
panel_13 = Panel("曲線の中点の色")
panel_14 = Panel("曲線のインデックスの色")
panel_15 = Panel("○が不要な線")
panel_16 = Panel("✕が違う線")
panel_17 = Panel("戻る")
panel_18 = Panel("進む")
panel_19 = Panel("端の調整")
panel_20 = Panel("ズーム")
panel_21 = Panel(panel)
panel_22 = Panel("曲線のインデックスの大きさ")
panel_23 = Panel("曲線の目印の大きさ")
values = ValueListener(Elements=slider_2, SomeProperty=True)  # -> Values, Indices
values_2 = ValueListener(Elements=pulldown, SomeProperty=True)  # -> Values, Indices
values_3 = ValueListener(Elements=button, SomeProperty=True)  # -> Values, Indices
values_4 = ValueListener(Elements=button_2, SomeProperty=True)  # -> Values, Indices
values_5 = ValueListener(Elements=button_3, SomeProperty=True)  # -> Values, Indices
values_6 = ValueListener(Elements=button_4, SomeProperty=True)  # -> Values, Indices
values_7 = ValueListener(Elements=slider, SomeProperty=True)  # -> Values, Indices
values_8 = ValueListener(Elements=pulldown_3, SomeProperty=True)  # -> Values, Indices
values_9 = ValueListener(Elements=checkbox, SomeProperty=True)  # -> Values, Indices
values_10 = ValueListener(Elements=toggle_5, SomeProperty=True)  # -> Values, Indices
values_11 = ValueListener(Elements=toggle_4, SomeProperty=True)  # -> Values, Indices
values_12 = ValueListener(Elements=pulldown_2, SomeProperty=True)  # -> Values, Indices
values_13 = ValueListener(Elements=colorpicker, SomeProperty=True)  # -> Values, Indices
values_14 = ValueListener(Elements=colorpicker_2, SomeProperty=True)  # -> Values, Indices
values_15 = ValueListener(Elements=colorpicker_3, SomeProperty=True)  # -> Values, Indices
values_16 = ValueListener(Elements=colorpicker_4, SomeProperty=True)  # -> Values, Indices
values_17 = ValueListener(Elements=colorpicker_5, SomeProperty=True)  # -> Values, Indices
eval = Evaluate(F="If(x = 0, \"extend\", \"trim\")", x=values_8.Indices)
setslider = SetSlider(UISlider=slider, Value=values_7.Values)
setslider_2 = SetSlider(UISlider=slider_2, Value=values.Values)

# ---- group: 反応を少し遅らせることで操作性を良くする
dam = DataDam(DataA=values_7.Values, BufferDelay=5000000, BufferMode=2)
dam_2 = DataDam(DataA=values.Values, BufferDelay=5000000, BufferMode=2)

# ----
python = PythonScript(
    curve=crv_3,
    loft_o=values_3.Values,
    loft_x=values_4.Values,
    undo=values_5.Values,
    next=values_6.Values,
    thickness=dam,
    height=dam_2,
    mode=eval,
    bake=values_9.Values,
    zoom=values_10.Values,
    past=values_11.Values,
    mark=values_12.Values)  # -> out, O, X, preview_o, preview_x, len_index, count_error, preview_wall; inputs curve: list of Curve
# ---------- python: Python ----------
# -*- coding: utf-8 -*-
import rhinoscriptsyntax as rs
import scriptcontext as sc
import Rhino
import time
#//////////////////////////////////////////////////////////////
if 'count_loop' not in sc.sticky:
    sc.sticky['count_loop'] = 0
if 'dict_distance' not in sc.sticky:
    sc.sticky['dict_distance'] = {}
if 'dict_combi' not in sc.sticky:
    sc.sticky['dict_combi'] = {}
if 'count_error' not in sc.sticky:
    sc.sticky['count_error'] = 0
if 'list_usedindex' not in sc.sticky:
    sc.sticky['list_usedindex'] = []
if 'list_history' not in sc.sticky:
    sc.sticky['list_history'] = []
#//////////////////////////////////////////////////////////////

#/////////////////////////////////////////////////////////////初回だけ点の座標の計算をする
#辞書(キーがそれぞれの曲線のインデックス、値が距離の近いものを順番に並べたリスト)を生成する関数
def Findclosestpt(crvs):
    dict_dist = {}
    list_midpt = [rs.CurveMidPoint(crv) for crv in crvs]
    count = 0
    while count != len(crvs):
        list_distance = [int(rs.Distance(list_midpt[count], i)) for i in list_midpt]
        list_sorted = zip(list_distance, range(len(crvs)))
        list_sorted.sort()
        list_distance, list_sortindex = zip(*list_sorted)
        dict_dist[count] = list_sortindex
        count += 1
    return dict_dist

start = time.time()
if sc.sticky['count_loop'] == 0:
    print("Start Calculate")
    sc.sticky['dict_distance'] = Findclosestpt(curve)
    print("End Calculate")

else:
    print("Skip Calculate")
end = time.time() - start
print("calculatetime = " + str(end))

#////////////////////////////////////////////////////////////２つのインデックスを求める
for remain in range(len(curve)):
    if remain in sc.sticky['list_usedindex']:
        pass
    else:
        index_o = remain#２つのうちの片方のインデックス
        break
list_loft_x = sc.sticky['dict_distance'].values()[index_o]
index_x = list_loft_x[1 + sc.sticky['count_error']]#もう片方のインデックス

#////////////////////////////////////////////////////////////辞書に登録する情報を作成
class Info():
	def __init__(self, crvs, ind_o, ind_x, num_loop, mode, thick, height):#コンストラクタ
		self.crvs = crvs
		self.ind_o = ind_o
		self.ind_x = ind_x
		self.num_loop = num_loop
		self.mode = mode
		self.thick = thick
		self.height = height

	def get_wall(self):#壁のインデックスを返却
		return self.num_loop
	def get_o(self):#曲線のインデックス１を返却
		return self.ind_o
	def get_x(self):#曲線のインデックス2を返却
		return self.ind_x
	def get_thick(self):#壁の厚みを返却
		return self.thick
	def get_height(self):#壁の高さを返却
		return self.height
	def get_adjust(self):#曲線の長さ調整の仕方を返却
		if self.mode == "extend":
			if rs.CurveLength(self.crvs[self.ind_o]) >= rs.CurveLength(self.crvs[self.ind_x]):
				pattern = 1
			else:
				pattern = 2
		else:
			if rs.CurveLength(self.crvs[self.ind_o]) >= rs.CurveLength(self.crvs[self.ind_x]):
				pattern = 3
			else:
				pattern = 4
		return pattern
data = Info(curve, index_o, index_x, sc.sticky["count_loop"], mode, thickness, height)
sc.sticky["dict_combi"][data.get_wall()] = (data.get_o(), data.get_x(), data.get_adjust(), data.get_thick(), data.get_height(),)

#////////////////////////////////////////////////////////////プレビューを作成
def Previewwall(dict, index, crvs, zoommode):
	if dict[index][2] == 1:
		A = crvs[dict[index][0]]
		B = rs.OffsetCurve(crvs[dict[index][0]], rs.CurveMidPoint(crvs[dict[index][1]]), dict[index][3])
	elif dict[index][2] == 2:
		A = rs.OffsetCurve(crvs[dict[index][1]], rs.CurveMidPoint(crvs[dict[index][0]]), dict[index][3])
		B = crvs[dict[index][1]]
	elif dict[index][2] == 3:
		A = rs.OffsetCurve(crvs[dict[index][1]], rs.CurveMidPoint(crvs[dict[index][0]]), dict[index][3])
		B = crvs[dict[index][1]]
	elif dict[index][2] == 4:
		A = crvs[dict[index][0]]
		B = rs.OffsetCurve(crvs[dict[index][0]], rs.CurveMidPoint(crvs[dict[index][1]]), dict[index][3])

	obj_srf = rs.AddLoftSrf([A, B])
	obj_height = rs.AddLine((0,0,0), (0,0,dict[index][4]))
	obj_wall = rs.ExtrudeSurface(obj_srf, obj_height)

	if zoommode:
		obj_zoom = rs.BoundingBox([obj_wall, crvs[dict[index][0]], crvs[dict[index][1]]])
		rs.ZoomBoundingBox(obj_zoom)

	return obj_wall

def Previewmark(crvs, dict, index):
	pt_o = rs.DivideCurve(crvs[dict[index][0]], 10)
	pt_x = rs.DivideCurve(crvs[dict[index][1]], 10)
	mark_o = [rs.AddCircle(cen, mark) for cen in pt_o]
	mark_x1 = [rs.AddLine((cen[0] - mark,cen[1],cen[2]), (cen[0] + mark,cen[1],cen[2])) for cen in pt_x]
	mark_x2 = [rs.AddLine((cen[0],cen[1] - mark,cen[2]), (cen[0],cen[1] + mark,cen[2])) for cen in pt_x]
	a = mark_o
	b = mark_x1 + mark_x2
	return (a, b)

start = time.time()
if next or loft_o or loft_x or undo or bake == True:
	print("preview pass")
	pass
else:
	if past == False:
		print("preview only one")
		preview_wall = Previewwall(sc.sticky["dict_combi"], data.get_wall(), curve, zoom)
	else:
		print("preview all")
		preview_wall = [Previewwall(sc.sticky["dict_combi"], i, curve, zoom) for i in sc.sticky["dict_combi"]]
preview_o = Previewmark(curve, sc.sticky["dict_combi"], data.get_wall())[0]
preview_x = Previewmark(curve, sc.sticky["dict_combi"], data.get_wall())[1]
end = time.time() - start
print("previewtime = " + str(end))

#////////////////////////////////////////////////////////////次の組み合わせを探す
if next:
    print("Input Key = next")
    if len(curve) - len(sc.sticky['list_usedindex']) <= 2:
        bake = True
        print("Start Bake")
    else:
        sc.sticky['count_loop'] += 1
        sc.sticky['count_error'] = 0
        sc.sticky['list_usedindex'].append(index_o)
        sc.sticky['list_usedindex'].append(index_x)
        sc.sticky['list_history'].append(2)

#//////////////////////////////////////////////////////////////ロフト元が違う場合
if loft_o:
    print("Input Key = loft_o")
    if len(curve) - len(sc.sticky['list_usedindex']) <= 2:
        bake = True
        print("Start Bake")
    else:
        sc.sticky['list_usedindex'].append(index_o)
        del sc.sticky['dict_combi'][sc.sticky['count_loop']]
        sc.sticky['count_loop'] += 1
        sc.sticky['count_error'] = 0
        sc.sticky['list_history'].append(1)

#//////////////////////////////////////////////////////////////ロフト先が違う場合
if loft_x:
    print("Input Key = loft_x")
    del sc.sticky['dict_combi'][sc.sticky['count_loop']]
    if sc.sticky['count_error'] == len(list_loft_x) - 2:
        sc.sticky['count_error'] = 0
    elif sc.sticky['count_error'] == 14:
        sc.sticky['count_error'] = 0
    else:
        sc.sticky['count_error'] += 1

#///////////////////////////////////////////////////////////////////////アンドゥ
def Undo():
	print("Input Key = Undo")
	if sc.sticky['count_loop'] == 0:
		sc.sticky['list_usedindex'] = []
		sc.sticky['list_history'] = []
		
	else:
		if sc.sticky['list_history'][-1] == 2:
			del sc.sticky['dict_combi'][sc.sticky['count_loop']]
			del sc.sticky['dict_combi'][sc.sticky['count_loop'] - 1]
			del sc.sticky['list_usedindex'][-1]
			del sc.sticky['list_usedindex'][-1]
		else:
			del sc.sticky['list_usedindex'][-1]
		del sc.sticky['list_history'][-1]
		sc.sticky['count_loop'] = sc.sticky['count_loop'] - 1

if undo:
	Undo()

#////////////////////////////////////////////////////////リセットするときの挙動
def Reset():
	print("Input Key = Undo")
	sc.sticky['count_loop'] = 0
	sc.sticky['count_error'] = 0
	sc.sticky['dict_distance'] = {}
	sc.sticky['dict_combi'] = {}
	sc.sticky['preview'] = []
	sc.sticky['list_usedindex'] = []
	sc.sticky['list_history'] = []

#///////////////////////////////////////////////////////////////////ベイクする
if bake:
	print("Input Key = bake")
	obj_bake = [Previewwall(sc.sticky["dict_combi"], i, curve, zoom) for i in sc.sticky["dict_combi"]]
	obj_zoom = rs.BoundingBox(obj_bake)
	rs.ZoomBoundingBox(obj_zoom)
	for wall in obj_bake:
		doc_obj = rs.coercerhinoobject(wall)
		doc_attributes = doc_obj.Attributes
		doc_geometry = doc_obj.Geometry
		sc.doc = Rhino.RhinoDoc.ActiveDoc
		rhino_obj = sc.doc.Objects.Add(doc_geometry, doc_attributes)
		sc.doc = ghdoc
	Reset()

O = data.ind_o
X = data.ind_x
count_error = "✕は" + str(sc.sticky['count_error'] + 1) + "番目の候補です"
len_index = len(sc.sticky['list_usedindex'])
# ---------- end python ----------
lng_2 = ListLength(List=python.preview_wall)
subtraction = Subtraction(A=lng_2, B=Slider(1, range=0..1))
col = Colour(values_17.Values)
# 操作に沿って選んだ曲線どうしで面を張り、壁を立てる
int = Integer(values_2.Values)
int_2 = Integer(values_2.Values)
col_2 = Colour(values_17.Values)
split = SplitList(List=python.preview_wall, Index=subtraction)  # -> ListA, ListB
item_2 = ListItem(List=crv_3, Index=python.O, Wrap=True)
item_3 = ListItem(List=crv_3, Index=python.X, Wrap=True)
curvepoint_2 = PointOnCurve(item_2, parameter=0.5)
curvepoint_3 = PointOnCurve(item_3, parameter=0.5)
pt_2 = Point(curvepoint)
crv_4 = Curve(python.preview_o)
crv_5 = Curve(python.preview_x)
tag = TextTag3D(Location=curvepoint_3, Text=python.X, Size=int_2, Colour=col_2, Justification=7)
tag_2 = TextTag3D(Location=curvepoint_2, Text=python.O, Size=int, Colour=col, Justification=7)
preview = CustomPreview(Geometry=pt_2, Shader=values_16.Values)
preview_2 = CustomPreview(Geometry=[crv_4, crv_5], Shader=values_15.Values)
preview_3 = CustomPreview(Geometry=split.ListA, Shader=values_14.Values)
preview_4 = CustomPreview(Geometry=split.ListB, Shader=values_13.Values)

# ---- group: 処理した曲線数
data = Data(python.len_index)

# ----
merge = Merge(Data1=lng, Data2=data)  # -> flatten(Result)

chart = CreateChart(Data=merge, Names=panel_5, ChartType=1)

# ----
# 要素・フォントのサイズ等を調整
number_slider_7 = Slider(12, range=0..100)
number_slider_8 = Slider(80, range=0..1000)
number_slider_9 = Slider(170, range=0..1000)
merge_2 = Merge(Data1=ColourSwatch(SwatchColor=RGB(186, 186, 186)), Data2=ColourSwatch(SwatchColor=RGB(87, 112, 43)))
adjustpos = AdjustElementPositioning(ElementsToAdjust=button, AbsolutePositioning=False, Width=number_slider_9, Height=number_slider_8, HorizontalAlignment=1)
adjustpos_2 = AdjustElementPositioning(
    ElementsToAdjust=button_2,
    AbsolutePositioning=False,
    Width=number_slider_9,
    Height=number_slider_8,
    HorizontalAlignment=1)
adjustpos_3 = AdjustElementPositioning(
    ElementsToAdjust=button_4,
    AbsolutePositioning=False,
    Width=Slider(301, range=0..1000),
    Height=Slider(50, range=0..100),
    HorizontalAlignment=0)
adjustpos_4 = AdjustElementPositioning(ElementsToAdjust=checkbox, AbsolutePositioning=False, Height=Slider(102, range=0..1000), HorizontalAlignment=0)
adjustpos_5 = AdjustElementPositioning(
    ElementsToAdjust=chart,
    Margin=Slider(0, range=0..100),
    AbsolutePositioning=False,
    Width=Slider(397, range=0..1000),
    Height=Slider(137, range=0..300),
    HorizontalAlignment=1,
    VerticalAlignment=2)
chartappearance = ChartAppearance(ChartToModify=chart, Colors=merge_2)
setchart = SetChartContents(ChartToModify=chart, NewChartValues=merge)
adjustelem = AdjustElementAppearance(ElementsToAdjust=button, Foreground=RGB(0, 0, 0), FontSize=number_slider_7)
adjustelem_2 = AdjustElementAppearance(ElementsToAdjust=button_2, Foreground=RGB(0, 0, 0), FontSize=number_slider_7)
adjustelem_3 = AdjustElementAppearance(ElementsToAdjust=button_4, Foreground=RGB(0, 0, 0), FontSize=number_slider_7)

# ----
# １つのタブに置く要素を
# 一つのツリーにまとめる
panel_24 = Panel("●color")
label = CreateLabel(LabelText=panel_24, LabelSize=12, Justification=0)
label_2 = CreateLabel(LabelText="●view", LabelSize=12, Justification=0)
panel_25 = Panel("----------------------------------------------------------------------------")
label_3 = CreateLabel(LabelText=panel_25, LabelSize=12, Justification=0)
label_4 = CreateLabel(LabelText=python.count_error, LabelSize=12, Justification=1)
label_5 = CreateLabel(LabelText=panel_25, LabelSize=12, Justification=0)
entwine = Entwine(
    Branch00=label_2,
    Branch01=expander,
    Branch02=expander_2,
    Branch03=expander_4,
    Branch04=expander_3,
    Branch05=label,
    Branch06=expander_5,
    Branch07=expander_6,
    Branch08=expander_7,
    Branch09=expander_8,
    Branch010=expander_9,
    FlattenInputs=True)
entwine_2 = Entwine(Branch00=checkbox, FlattenInputs=True)
entwine_3 = Entwine(
    Branch00=label_5,
    Branch01=stack,
    Branch02=stack_2,
    Branch04=slider,
    Branch05=slider_2,
    Branch07=pulldown_3,
    Branch08=label_3,
    Branch09=label_4,
    Branch010=chart,
    FlattenInputs=True)

# ---- group: タブごとにまとめてウィンドウに配置する
tabs = TabbedView(TabNames=panel_8, TabTextSize=number_slider, Tab0=flatten(entwine_3), Tab1=flatten(entwine_2), Tab2=flatten(entwine))
addelems = AddElements(Window=launchwin, Elements=flatten(tabs), DoVLChecking=True)  # -> AddedElements, ElementNames
